# Grasshopper definition A3-Clip.gh (Grasshopper 1.0.7)

radius = Slider(5, range=1..5)
slot_depth = Slider(20, range=0..40)
slot_width = Slider(2.835, range=2..3)
negative = Negative(Value=radius)
division = Division(A=slot_width, B=-2)
multiplication = Multiplication(A=radius, B=2)
addition = Addition(A=slot_depth, B=2)
vector_xyz = VectorXYZ(XComponent=negative, YComponent=0, ZComponent=0)  # -> Vector, Length
vector_xyz_2 = VectorXYZ(XComponent=division, YComponent=radius, ZComponent=0)  # -> Vector, Length
clips = Rectangle(Plane=PlaneXY(0, 0, 0), XSize=multiplication, YSize=slot_depth, Radius=0)  # -> Rectangle, Length
cardboard_slot = Rectangle(Plane=PlaneXY(0, 0, 0), XSize=slot_width, YSize=addition, Radius=0)  # -> Rectangle, Length
move = Move(Geometry=cardboard_slot.Rectangle, Motion=vector_xyz_2.Vector)  # -> Geometry, Transform
move_2 = Move(Geometry=clips.Rectangle, Motion=vector_xyz.Vector)  # -> Geometry, Transform
rotate = Rotate(Geometry=move.Geometry, Angle=1.570796327, Plane=PlaneXY(0, 0, 0))  # -> Geometry, Transform
rotate_2 = Rotate(Geometry=move_2.Geometry, Angle=1.570796327, Plane=PlaneXY(0, 0, 0))  # -> Geometry, Transform
circle = Circle(Plane=PlaneXY(0, 0, 0), Radius=radius)
group = Group(Objects=[move.Geometry, rotate.Geometry])
group_2 = Group(Objects=[rotate_2.Geometry, move_2.Geometry, circle])
