# Grasshopper definition A3-NestingObject.gh (Grasshopper 1.0.7)

offset_distance = Slider(1, range=0..5)
polygon_size = Slider(2, range=0..5)
polygon_sides = Slider(6, range=0..10)
polygon = Polygon(Plane=PlaneXY(0, 0, 0), Radius=polygon_size, Segments=polygon_sides, FilletRadius=0)  # -> Polygon, Length
multiplication = Multiplication(A=offset_distance, B=2)
offset_curve = OffsetCurve(Curve=polygon.Polygon, Distance=offset_distance, Plane=PlaneXY(0, 0, 0), Corners=1)
offset_curve_2 = OffsetCurve(Curve=polygon.Polygon, Distance=multiplication, Plane=PlaneXY(0, 0, 0), Corners=1)
