# Grasshopper definition A5-Clip.gh (Grasshopper 1.0.7)

radius = Slider(2, range=1..5)
slot_depth = Slider(10, range=0..40)
slot_width = Slider(1.438, range=1..3)
negative = Negative(Value=radius)
division = Division(A=slot_width, B=-2)
multiplication = Multiplication(A=radius, B=2)
addition = Addition(A=slot_depth, B=2)
vector_xyz = VectorXYZ(XComponent=negative, YComponent=0, ZComponent=0)  # -> Vector, Length
vector_xyz_2 = VectorXYZ(XComponent=division, YComponent=radius, ZComponent=0)  # -> Vector, Length
clips = Rectangle(Plane=PlaneXY(0, 0, 0), XSize=multiplication, YSize=slot_depth, Radius=0)  # -> Rectangle, Length
cardboard_slot = Rectangle(Plane=PlaneXY(0, 0, 0), XSize=slot_width, YSize=addition, Radius=0)  # -> Rectangle, Length
angle = Slider(116.565, range=0..360)
move = Move(Geometry=cardboard_slot.Rectangle, Motion=vector_xyz_2.Vector)  # -> Geometry, Transform
move_2 = Move(Geometry=clips.Rectangle, Motion=vector_xyz.Vector)  # -> Geometry, Transform
rotate = Rotate(Geometry=move.Geometry, Angle=degrees(angle), Plane=PlaneXY(0, 0, 0))  # -> Geometry, Transform
rotate_2 = Rotate(
    Geometry=move_2.Geometry,
    Angle=degrees(angle),
    Plane=Plane(origin=(0, 0, 0), x=(0.9999989581, -0.001443569522, 0), y=(0.001443569522, 0.9999989581, 0)))  # -> Geometry, Transform
circle = Circle(Plane=PlaneXY(0, 0, 0), Radius=radius)
group = Group(Objects=[move.Geometry, rotate.Geometry])
group_2 = Group(Objects=[move_2.Geometry, circle, rotate_2.Geometry])
