# Grasshopper definition A8-Adapter1.gh (Grasshopper 1.0.7)

anchor_2_y_value = Slider(38, range=0..200)
anchor_2_x_value = Slider(38, range=0..200)
anchor_2_z_value = Slider(7, range=0..200)
anchor_1_y_value = Slider(0, range=0..200)
anchor_1_x_value = Slider(0, range=0..200)
anchor_1_z_value = Slider(0, range=0..200)
length = Slider(19.448, range=0..200)
radius = Slider(7.037, range=0..15)
radius_2 = Slider(3.6, range=0..5)

anchor_1_coordinate = ConstructPoint(XCoordinate=anchor_1_x_value, YCoordinate=anchor_1_y_value, ZCoordinate=anchor_1_z_value)
anchor_2_coordinate = ConstructPoint(XCoordinate=anchor_2_x_value, YCoordinate=anchor_2_y_value, ZCoordinate=anchor_2_z_value)
square_adapter = Box2Pt(PointA=anchor_1_coordinate, PointB=anchor_2_coordinate, Plane=PlaneXY(0, 0, 0))
brep = Brep(square_adapter)

length_2 = Slider(10, range=0..200)
radius_3 = Slider(1.8, range=0..5)

division = Division(A=anchor_2_y_value, B=2)
multiplication = Multiplication(A=anchor_2_y_value, B=0.833)
division_2 = Division(A=anchor_2_y_value, B=6)
vector_xyz = VectorXYZ(XComponent=division, YComponent=division_2, ZComponent=0)  # -> Vector, Length
vector_xyz_2 = VectorXYZ(XComponent=multiplication, YComponent=division, ZComponent=0)  # -> Vector, Length
vector_xyz_3 = VectorXYZ(XComponent=division_2, YComponent=division, ZComponent=0)  # -> Vector, Length
screw_hole = Cylinder(Base=PlaneXY(0, 0, 0), Radius=radius_3, Length=length_2)
move = Move(Geometry=screw_hole, Motion=vector_xyz_3.Vector)  # -> Geometry, Transform
move_2 = Move(Geometry=screw_hole, Motion=vector_xyz.Vector)  # -> Geometry, Transform
move_3 = Move(Geometry=screw_hole, Motion=vector_xyz_2.Vector)  # -> Geometry, Transform
brep_2 = Brep(move.Geometry)
brep_3 = Brep(move_3.Geometry)
brep_4 = Brep(move_2.Geometry)

pipe_wall = Cylinder(Base=PlaneXY(0, 0, 0), Radius=radius, Length=length)
height_adjustment = Slider(1.296, range=0..5)
pipe_hole = Cylinder(Base=PlaneXY(0, 0, 0), Radius=radius_2, Length=length)
vector_xyz_4 = VectorXYZ(XComponent=division, YComponent=division, ZComponent=height_adjustment)  # -> Vector, Length
move_4 = Move(Geometry=pipe_wall, Motion=vector_xyz_4.Vector)  # -> Geometry, Transform
move_5 = Move(Geometry=pipe_hole, Motion=vector_xyz_4.Vector)  # -> Geometry, Transform
rotation = Slider(12, range=0..360)
rotate = Rotate(
    Geometry=move_5.Geometry,
    Angle=degrees(rotation),
    Plane=Plane(origin=(0, 21.85365654, 7.351535118), x=(0, 0, 1), y=(0, 1, 0)))  # -> Geometry, Transform
rotate_2 = Rotate(
    Geometry=move_4.Geometry,
    Angle=degrees(rotation),
    Plane=Plane(origin=(0, 21.85365654, 7.351535118), x=(0, 0, 1), y=(0, 1, 0)))  # -> Geometry, Transform
brep_5 = Brep(rotate.Geometry)
brep_6 = Brep(rotate_2.Geometry)
cap_holes = CapHoles(Brep=brep_6)
cap_holes_2 = CapHoles(Brep=brep_5)
solid_difference = SolidDifference(BrepsA=cap_holes, BrepsB=cap_holes_2)

solid_difference_2 = SolidDifference(BrepsA=brep, BrepsB=brep_2)
solid_difference_3 = SolidDifference(BrepsA=solid_difference_2, BrepsB=brep_4)
solid_difference_4 = SolidDifference(BrepsA=solid_difference_3, BrepsB=brep_3)
solid_union = SolidUnion(Breps=[solid_difference_4, solid_difference])
