# Grasshopper definition A8-Adapter2.gh (Grasshopper 1.0.7)

radius = Slider(3.6, range=0..5)
length = Slider(151, range=0..200)
anchor_1_xyz_value = Slider(0, range=0..10)
anchor_1_xyz_value_2 = Slider(19, range=0..100)
anchor_2_x_value = Slider(64, range=0..100)
anchor_2_y_value = Slider(89, range=0..100)
anchor_2_z_value = Slider(62, range=0..100)
rotation = Slider(90, range=-180..180)
cylinder = Cylinder(Base=PlaneXY(0, 0, 0), Radius=radius, Length=length)
division = Division(A=anchor_2_x_value, B=2)
division_2 = Division(A=anchor_2_y_value, B=2)
anchor_1_coordinate = ConstructPoint(XCoordinate=anchor_1_xyz_value, YCoordinate=anchor_1_xyz_value, ZCoordinate=anchor_1_xyz_value_2)
anchor_2_coordinate = ConstructPoint(XCoordinate=anchor_2_x_value, YCoordinate=anchor_2_y_value, ZCoordinate=anchor_2_z_value)
radius_2 = Slider(3.6, range=0..5)
length_2 = Slider(67, range=0..200)
radius_3 = Slider(3.6, range=0..5)
length_3 = Slider(67, range=0..200)
move = Slider(8.5, range=-180..180)
move_2 = Slider(100, range=-180..180)
move_3 = Slider(53, range=0..100)
rotate = Rotate(Geometry=cylinder, Angle=degrees(rotation), Plane=PlaneYZ(0, 10.03692916, 10.13833961))  # -> Geometry, Transform
square_adapter = Box2Pt(PointA=anchor_1_coordinate, PointB=anchor_2_coordinate, Plane=PlaneXY(0, 0, 0))
vector_xyz = VectorXYZ(XComponent=division, YComponent=0, ZComponent=0)  # -> Vector, Length
vector_xyz_2 = VectorXYZ(XComponent=0, YComponent=division_2, ZComponent=0)  # -> Vector, Length
vector_xyz_3 = VectorXYZ(XComponent=move, YComponent=move_2, ZComponent=move_3)  # -> Vector, Length
pipe_hole = Cylinder(Base=PlaneXY(0, 0, 0), Radius=radius_2, Length=length_2)
pipe_hole_2 = Cylinder(Base=PlaneXY(0, 0, 0), Radius=radius_3, Length=length_3)
brep = Brep(square_adapter)
move_4 = Move(Geometry=pipe_hole_2, Motion=vector_xyz_2.Vector)  # -> Geometry, Transform
move_5 = Move(Geometry=pipe_hole_2, Motion=vector_xyz_2.Vector)  # -> Geometry, Transform
rotation_2 = Slider(12, range=-180..180)
rotation_3 = Slider(-12, range=-180..180)
rotation_4 = Slider(26, range=-180..180)
move_6 = Move(Geometry=pipe_hole, Motion=vector_xyz.Vector)  # -> Geometry, Transform
move_7 = Move(Geometry=pipe_hole, Motion=vector_xyz.Vector)  # -> Geometry, Transform
rotation_5 = Slider(-26, range=-180..180)
move_8 = Move(Geometry=rotate.Geometry, Motion=vector_xyz_3.Vector)  # -> Geometry, Transform
addition = Addition(A=move, B=38)
brep_2 = Brep(move_8.Geometry)
brep_3 = Brep(move_8.Geometry)
rotate_2 = Rotate(
    Geometry=move_6.Geometry,
    Angle=degrees(rotation_4),
    Plane=Plane(origin=(0, 21.85365654, 7.351535118), x=(0, 0, 1), y=(0, 1, 0)))  # -> Geometry, Transform
rotate_3 = Rotate(
    Geometry=move_7.Geometry,
    Angle=degrees(rotation_5),
    Plane=Plane(origin=(0, 21.85365654, 7.351535118), x=(0, 0, 1), y=(0, 1, 0)))  # -> Geometry, Transform
rotate_4 = Rotate(Geometry=move_4.Geometry, Angle=degrees(rotation_2), Plane=PlaneXZ(6.332492676, 0, 10.05599837))  # -> Geometry, Transform
rotate_5 = Rotate(Geometry=move_5.Geometry, Angle=degrees(rotation_3), Plane=PlaneXZ(6.332492676, 0, 10.05599837))  # -> Geometry, Transform
y_value = Slider(73, range=0..100)
y_value_2 = Slider(14, range=0..100)
x_value = Slider(50, range=0..100)
x_value_2 = Slider(14, range=0..100)
vector_xyz_4 = VectorXYZ(XComponent=addition, YComponent=0, ZComponent=0)  # -> Vector, Length
cap_holes = CapHoles(Brep=brep_2)
cap_holes_2 = CapHoles(Brep=brep_3)
brep_4 = Brep(rotate_2.Geometry)
brep_5 = Brep(rotate_3.Geometry)
brep_6 = Brep(rotate_4.Geometry)
brep_7 = Brep(rotate_5.Geometry)
vector_xyz_5 = VectorXYZ(XComponent=0, YComponent=y_value, ZComponent=7)  # -> Vector, Length
vector_xyz_6 = VectorXYZ(XComponent=0, YComponent=y_value_2, ZComponent=-12)  # -> Vector, Length
move_9 = Move(Geometry=cap_holes_2, Motion=vector_xyz_4.Vector)  # -> Geometry, Transform
vector_xyz_7 = VectorXYZ(XComponent=x_value, YComponent=1, ZComponent=-6)  # -> Vector, Length
vector_xyz_8 = VectorXYZ(XComponent=x_value_2, YComponent=1, ZComponent=-9)  # -> Vector, Length
cap_holes_3 = CapHoles(Brep=brep_4)
cap_holes_4 = CapHoles(Brep=brep_5)
cap_holes_5 = CapHoles(Brep=brep_6)
cap_holes_6 = CapHoles(Brep=brep_7)
move_10 = Move(Geometry=cap_holes_5, Motion=vector_xyz_7.Vector)  # -> Geometry, Transform
move_11 = Move(Geometry=cap_holes_3, Motion=vector_xyz_6.Vector)  # -> Geometry, Transform
move_12 = Move(Geometry=cap_holes_4, Motion=vector_xyz_5.Vector)  # -> Geometry, Transform
move_13 = Move(Geometry=cap_holes_6, Motion=vector_xyz_8.Vector)  # -> Geometry, Transform
solid_difference = SolidDifference(BrepsA=brep, BrepsB=move_11.Geometry)
solid_difference_2 = SolidDifference(BrepsA=solid_difference, BrepsB=move_12.Geometry)
solid_difference_3 = SolidDifference(BrepsA=solid_difference_2, BrepsB=move_10.Geometry)
solid_difference_4 = SolidDifference(BrepsA=solid_difference_3, BrepsB=move_13.Geometry)
solid_difference_5 = SolidDifference(BrepsA=solid_difference_4, BrepsB=cap_holes)
solid_difference_6 = SolidDifference(BrepsA=solid_difference_5, BrepsB=move_9.Geometry)
